# Grasshopper definition Workshop (1).gh (Grasshopper 0.9.76)
# plug-ins: Tarsier, TT Toolbox

# ---- group: Wind / ReadExcel
read_excel_sheet = ReadExcelSheet(Run=Toggle(True), Worksheet="Sheet1", Listen=False)  # -> UserMessages, Columns, Rows

# ---- group: Temperature
read_excel_sheet_2 = ReadExcelSheet(Run=Toggle(True), Worksheet="Sheet2", Listen=False)  # -> UserMessages, Columns, Rows

# ---- group: Precipitation / ReadExcelData
read_excel_sheet_3 = ReadExcelSheet(Run=Toggle(True), Worksheet="Sheet3", Listen=False)  # -> UserMessages, Columns, Rows

# ---- group: Ice / ReadExcelData
read_excel_sheet_4 = ReadExcelSheet(Run=Toggle(True), Worksheet="Sheet4", Listen=False)  # -> UserMessages, Columns, Rows

# ---- group: Wind / WindLongitude
list_item = ListItem(List=read_excel_sheet.Rows, Index=Slider(1, range=0..100), Wrap=True)  # -> flatten(Item)
cull_index = CullIndex(List=list_item, Indices=Slider(0, range=0..100), Wrap=True)
radians = Radians(Degrees=cull_index)

# ---- group: Wind / WindLatitude
list_item_2 = ListItem(List=read_excel_sheet.Rows, Index=Slider(0, range=0..100), Wrap=True)  # -> flatten(Item)
cull_index_2 = CullIndex(List=list_item_2, Indices=Slider(0, range=0..100), Wrap=True)
radians_2 = Radians(Degrees=cull_index_2)

# ---- group: Wind
list_item_3 = ListItem(List=read_excel_sheet.Rows, Index=Slider(2, range=0..100), Wrap=True)  # -> flatten(Item)
cull_index_3 = CullIndex(List=list_item_3, Indices=Slider(0, range=0..100), Wrap=True)
c_script = CSharpScript(x=flatten(cull_index_3))  # -> out, A; inputs x: String
# ---------- c_script: C# ----------
    string ou = x;

    if( ou == "" ) ou = "1";

    double inte = System.Convert.ToDouble(ou);

    A = ou;
# ---------- end c_script ----------
number_slider = Slider(0.5, range=0..1000)  # disabled
bounds = Bounds(Numbers=c_script.A)  # disabled
construct_domain = ConstructDomain(DomainStart=0, DomainEnd=number_slider)  # disabled
bounds_2 = Bounds(Numbers=c_script.A)
construct_domain_2 = ConstructDomain(DomainStart=0, DomainEnd=Slider(255, range=0..1000))
remap_numbers = RemapNumbers(Value=c_script.A, Source=bounds, Target=construct_domain)  # -> Mapped, Clipped; disabled
remap_numbers_2 = RemapNumbers(Value=c_script.A, Source=bounds_2, Target=construct_domain_2)  # -> Mapped, Clipped

# ---- group: Temperature / TemperatureLongitude
list_item_4 = ListItem(List=read_excel_sheet_2.Rows, Index=Slider(1, range=0..100), Wrap=True)  # -> flatten(Item)
cull_index_4 = CullIndex(List=list_item_4, Indices=Slider(0, range=0..100), Wrap=True)
radians_3 = Radians(Degrees=cull_index_4)

# ---- group: Temperature / TemperatureLatitude
list_item_5 = ListItem(List=read_excel_sheet_2.Rows, Index=Slider(0, range=0..100), Wrap=True)  # -> flatten(Item)
cull_index_5 = CullIndex(List=list_item_5, Indices=Slider(0, range=0..100), Wrap=True)
radians_4 = Radians(Degrees=cull_index_5)

# ---- group: Temperature
list_item_6 = ListItem(List=read_excel_sheet_2.Rows, Index=Slider(2, range=0..100), Wrap=True)  # -> flatten(Item)
cull_index_6 = CullIndex(List=list_item_6, Indices=Slider(0, range=0..100), Wrap=True)
c_script_2 = CSharpScript(x=flatten(cull_index_6))  # -> out, A; inputs x: String; same code as c_script
bounds_3 = Bounds(Numbers=c_script_2.A)
construct_domain_3 = ConstructDomain(DomainStart=0, DomainEnd=Slider(255, range=0..1000))
remap_numbers_3 = RemapNumbers(Value=c_script_2.A, Source=bounds_3, Target=construct_domain_3)  # -> Mapped, Clipped

# ---- group: Precipitation / PrecipitationLongitude
list_item_7 = ListItem(List=read_excel_sheet_3.Rows, Index=Slider(1, range=0..100), Wrap=True)  # -> flatten(Item)
cull_index_7 = CullIndex(List=list_item_7, Indices=Slider(0, range=0..100), Wrap=True)
radians_5 = Radians(Degrees=cull_index_7)

# ---- group: Precipitation / PrecipitationLatitude
list_item_8 = ListItem(List=read_excel_sheet_3.Rows, Index=Slider(0, range=0..100), Wrap=True)  # -> flatten(Item)
cull_index_8 = CullIndex(List=list_item_8, Indices=Slider(0, range=0..100), Wrap=True)
radians_6 = Radians(Degrees=cull_index_8)

# ---- group: Ice / IceLatitude
list_item_9 = ListItem(List=read_excel_sheet_4.Rows, Index=Slider(0, range=0..100), Wrap=True)  # -> flatten(Item)
cull_index_9 = CullIndex(List=list_item_9, Indices=Slider(0, range=0..100), Wrap=True)
radians_7 = Radians(Degrees=cull_index_9)

# ---- group: Ice / IceLongitude
list_item_10 = ListItem(List=read_excel_sheet_4.Rows, Index=Slider(1, range=0..100), Wrap=True)  # -> flatten(Item)
cull_index_10 = CullIndex(List=list_item_10, Indices=Slider(0, range=0..100), Wrap=True)
radians_8 = Radians(Degrees=cull_index_10)

# ---- group: Precipitation
list_item_11 = ListItem(List=read_excel_sheet_3.Rows, Index=Slider(2, range=0..100), Wrap=True)  # -> flatten(Item)
cull_index_11 = CullIndex(List=list_item_11, Indices=Slider(0, range=0..100), Wrap=True)
c_script_3 = CSharpScript(x=flatten(cull_index_11))  # -> out, A; inputs x: String; same code as c_script
bounds_4 = Bounds(Numbers=c_script_3.A)
construct_domain_4 = ConstructDomain(DomainStart=0, DomainEnd=Slider(255, range=0..1000))
remap_numbers_4 = RemapNumbers(Value=c_script_3.A, Source=bounds_4, Target=construct_domain_4)  # -> Mapped, Clipped

# ---- group: Ice
list_item_12 = ListItem(List=read_excel_sheet_4.Rows, Index=Slider(2, range=0..100), Wrap=True)  # -> flatten(Item)
cull_index_12 = CullIndex(List=list_item_12, Indices=Slider(0, range=0..100), Wrap=True)
c_script_4 = CSharpScript(x=flatten(cull_index_12))  # -> out, A; inputs x: String; same code as c_script
bounds_5 = Bounds(Numbers=c_script_4.A)
construct_domain_5 = ConstructDomain(DomainStart=0, DomainEnd=Slider(255, range=0..1000))
remap_numbers_5 = RemapNumbers(Value=c_script_4.A, Source=bounds_5, Target=construct_domain_5)  # -> Mapped, Clipped

# ---- group: Projections
number_slider_2 = Slider(0.001, range=0..1)

# ---- group: Projections / Cassini
cassini = CSharpScript(lat=radians_2, lon=radians)  # -> out, A; inputs lat: Double, lon: Double
# ---------- cassini: C# ----------
    A = CassiniProjection(lat, lon);
# ---------- cassini: C# additional code ----------
  public Point3d CassiniProjection(double lat, double lon)
  {

    var earthRadius = 6367;

    var x = earthRadius * Math.Asin(Math.Cos(lat) * Math.Sin(lon));
    var y = earthRadius * Math.Atan2(Math.Sin(lat), Math.Cos(lat) * Math.Cos(lon));
    var z = earthRadius * Math.Sin(lat);
    return new Point3d(x, y, 0);

  }
# ---------- end cassini ----------
cassini_2 = CSharpScript(lat=radians_4, lon=radians_3)  # -> out, A; inputs lat: Double, lon: Double; same code as cassini
number_slider_3 = Slider(0.001, range=0..1)
multiplication = Multiplication(A=cassini.A, B=number_slider_2)
multiplication_2 = Multiplication(A=cassini_2.A, B=number_slider_3)

# ---- group: Projections / Spherical
spherical = CSharpScript(x=radians, y=radians_2)  # -> out, A; inputs x: Double, y: Double
# ---------- spherical: C# ----------
    A = convertSphericalToCartesian(x, y);
# ---------- spherical: C# additional code ----------
  public Point3d convertSphericalToCartesian(double lat, double lon)
  {

    var earthRadius = 6367;

    var x = earthRadius * Math.Cos(lat) * Math.Cos(lon);
    var y = earthRadius * Math.Cos(lat) * Math.Sin(lon);
    var z = earthRadius * Math.Sin(lat);
    return new Point3d(x, y, z);

  }
# ---------- end spherical ----------
spherical_2 = CSharpScript(x=radians_3, y=radians_4)  # -> out, A; inputs x: Double, y: Double; same code as spherical
multiplication_3 = Multiplication(A=spherical.A, B=number_slider_2)
multiplication_4 = Multiplication(A=spherical_2.A, B=number_slider_3)

# ---- group: Precipitation / Projections
number_slider_4 = Slider(0.001, range=0..1)

# ---- group: Precipitation / Projections / Cassini
cassini_3 = CSharpScript(lat=radians_6, lon=radians_5)  # -> out, A; inputs lat: Double, lon: Double; same code as cassini
multiplication_5 = Multiplication(A=cassini_3.A, B=number_slider_4)

# ---- group: Precipitation / Projections / Spherical
spherical_3 = CSharpScript(x=radians_5, y=radians_6)  # -> out, A; inputs x: Double, y: Double; same code as spherical
multiplication_6 = Multiplication(A=spherical_3.A, B=number_slider_4)

# ---- group: Ice / Projections
number_slider_5 = Slider(0.001, range=0..1)

# ---- group: Ice / Projections / Cassini
cassini_4 = CSharpScript(lat=radians_7, lon=radians_8)  # -> out, A; inputs lat: Double, lon: Double; same code as cassini
multiplication_7 = Multiplication(A=cassini_4.A, B=number_slider_5)

# ---- group: Ice / Projections / Spherical
spherical_4 = CSharpScript(x=radians_8, y=radians_7)  # -> out, A; inputs x: Double, y: Double; same code as spherical
multiplication_8 = Multiplication(A=spherical_4.A, B=number_slider_5)

# ---- group: PointCloudViz
colour_rgb = ColourRGB(Alpha=255, Red=expr("x*10", remap_numbers_3.Clipped), Green=0, Blue=0)
colour_rgb_2 = ColourRGB(Alpha=255, Red=remap_numbers_2.Mapped, Green=remap_numbers_2.Mapped, Blue=remap_numbers_2.Mapped)
colour_rgb_3 = ColourRGB(Alpha=255, Red=0, Green=0, Blue=remap_numbers_4.Mapped)
colour_rgb_4 = ColourRGB(Alpha=255, Red=remap_numbers_5.Mapped, Green=remap_numbers_5.Mapped, Blue=remap_numbers_5.Mapped)
construct_point_cloud = ConstructPointCloud(Points=multiplication_3, Colours=colour_rgb_2)
construct_point_cloud_2 = ConstructPointCloud(Points=multiplication_4, Colours=colour_rgb)
construct_point_cloud_3 = ConstructPointCloud(Points=multiplication_6, Colours=colour_rgb_3)
construct_point_cloud_4 = ConstructPointCloud(Points=multiplication_8, Colours=colour_rgb_4)
preview_point_cloud = PreviewPointCloud(PointCloud=construct_point_cloud, Weight=Slider(4, range=0..10))
preview_point_cloud_2 = PreviewPointCloud(PointCloud=construct_point_cloud_2, Weight=Slider(13, range=0..20))
preview_point_cloud_3 = PreviewPointCloud(PointCloud=construct_point_cloud_3, Weight=Slider(3, range=0..10))
preview_point_cloud_4 = PreviewPointCloud(PointCloud=construct_point_cloud_4, Weight=Slider(10, range=0..10))

# ---- group: BoxesAndDisplacement
construct_point = ConstructPoint(XCoordinate=0, YCoordinate=0, ZCoordinate=0)  # disabled
vector_2pt = Vector2Pt(PointA=construct_point, PointB=multiplication_3, Unitize=False)  # -> Vector, Length; disabled
amplitude = Amplitude(Vector=vector_2pt.Vector, Amplitude=remap_numbers_3.Mapped)  # disabled
number = Number(remap_numbers.Mapped)  # disabled
vector_display = VectorDisplay(Anchor=construct_point, Vector=amplitude)  # disabled
move = Move(Geometry=multiplication_3, Motion=amplitude)  # -> Geometry, Transform; disabled
center_box = CenterBox(Base=move.Geometry, X=number, Y=number, Z=number)  # disabled

# ----
colour_rgb_5 = ColourRGB(Alpha=255, Red=remap_numbers_2.Mapped, Green=remap_numbers_2.Mapped, Blue=remap_numbers_2.Mapped)  # disabled
construct_point_cloud_5 = ConstructPointCloud(Points=[multiplication_3, multiplication_4])  # disabled
number_slider_6 = Slider(4, range=0..10)  # disabled
preview_point_cloud_5 = PreviewPointCloud(PointCloud=construct_point_cloud_5, Weight=number_slider_6)  # disabled
